# Grasshopper definition fabduck.gh (Grasshopper 0.9.76)

# ---- group: cap internal half duck
srf = Surface(<surface referenced from the Rhino model>)

# ---- group: half duck
brep = Brep(<brep referenced from the Rhino model>)

# ---- group: SCALE
area = Area(Geometry=brep)  # -> Area, Centroid
scale = Scale(Geometry=brep, Center=area.Centroid, Factor=Slider(0.8, range=0..1))  # -> Geometry, Transform
edges = BrepEdges(Brep=scale.Geometry)  # -> Naked, Interior, NonManifold
crv = Curve(edges.Naked)

# ---- group: ISO
brep_2 = Brep(<brep referenced from the Rhino model>)

# ----
debrep = DeconstructBrep(Brep=brep_2)  # -> Faces, Edges, Vertices
item = ListItem(List=debrep.Faces, Index=Slider(8, range=0..10), Wrap=True)
area_2 = Area(Geometry=item)  # -> Area, Centroid

data = Data("1.008826")
data_2 = Data(1.152542099)

boundary = BoundarySurfaces(Edges=crv)
data_3 = Data("1.159956")
scale_nu = ScaleNU(Geometry=brep_2, Plane=area_2.Centroid, ScaleX=Slider(1.1875, range=0..10), ScaleY=1, ScaleZ=1)  # -> Geometry, Transform

md_slider = MDSlider(slider_value=Point(0.5, 0.5, 0.5), SliderMode=0, x_domain=Domain(0, 1), y_domain=Domain(0, 1), z_domain=Domain(0, 1))
evalsrf = EvaluateSurface(Surface=reparameterize(boundary), Point=md_slider)  # -> Point, Normal, Frame
circle = CircleCNR(Center=evalsrf.Point, Normal=evalsrf.Frame, Radius=Slider(3, range=0..30))

md_slider_2 = MDSlider(slider_value=Point(0.5, 0.5, 0.5), SliderMode=0, x_domain=Domain(0, 1), y_domain=Domain(0, 1), z_domain=Domain(0, 1))
evalsrf_2 = EvaluateSurface(Surface=srf, Point=md_slider_2)  # -> Point, Normal, Frame
projecta = ProjectAlong(Geometry=circle, Plane=evalsrf_2.Frame, Direction=evalsrf_2.Normal)  # -> Geometry, Transform

boundary_2 = BoundarySurfaces(Edges=projecta.Geometry)
md_slider_3 = MDSlider(
    slider_value=Point(0.5035095215, 0.5029377937, 0.5),
    SliderMode=0,
    x_domain=Domain(0, 1),
    y_domain=Domain(0, 1),
    z_domain=Domain(0, 1))
evalsrf_3 = EvaluateSurface(Surface=reparameterize(boundary_2), Point=md_slider_3)  # -> Point, Normal, Frame

loft = Loft(
    Curves=flatten([projecta.Geometry, circle]),
    Options={Adjust=False, Closed=False, LoftEnds=0, LoftSimp=0, LoftType=0, Rebuild=10, Refit=0.01})

area_3 = Area(Geometry=projecta.Geometry)  # -> Area, Centroid
area_4 = Area(Geometry=circle)  # -> Area, Centroid
dist = Distance(PointA=area_3.Centroid, PointB=area_4.Centroid)
panel = Panel(dist)

curvepoint = PointOnCurve(circle, parameter=0.5)
end = EndPoints(Curve=circle)  # -> Start, End
ln = Line(StartPoint=curvepoint, EndPoint=end.Start)
scale_2 = Scale(Geometry=ln, Center=Point(0, 0, 0), Factor=Slider(0.15, range=0..1))  # -> Geometry, Transform
len = Length(Curve=ln)
panel_2 = Panel(len)

geo = Geometry([boundary, srf])

untrim = Untrim(Surface=srf)
deplane = DeconstructPlane(Plane=untrim)  # -> Origin, XAxis, YAxis, ZAxis
area_5 = Area(Geometry=untrim)  # -> Area, Centroid
pl = ConstructPlane(Origin=evalsrf_3.Frame, XAxis=deplane.XAxis, YAxis=deplane.YAxis)

number_slider = Slider(0.97, range=0..1)
number_slider_2 = Slider(0.8, range=0..1)
brep_3 = Brep(<brep referenced from the Rhino model>)
amp = Amplitude(Vector=evalsrf_3.Normal, Amplitude=Slider(5, range=0..10))

debrep_2 = DeconstructBrep(Brep=scale_nu.Geometry)  # -> Faces, Edges, Vertices
item_2 = ListItem(List=debrep_2.Faces, Index=Slider(7, range=0..10), Wrap=True)
md_slider_4 = MDSlider(
    slider_value=Point(0.5035095215, 0.5029377937, 0.5),
    SliderMode=0,
    x_domain=Domain(0, 1),
    y_domain=Domain(0, 1),
    z_domain=Domain(0, 1))

item_3 = ListItem(List=debrep_2.Faces, Index=Slider(8, range=0..10), Wrap=True)
area_6 = Area(Geometry=item_2)  # -> Area, Centroid
area_7 = Area(Geometry=item_3)  # -> Area, Centroid
dist_2 = Distance(PointA=area_7.Centroid, PointB=area_6.Centroid)

edges_2 = BrepEdges(Brep=item_2)  # -> Naked, Interior, NonManifold
boundary_3 = BoundarySurfaces(Edges=edges_2.Naked)

evalsrf_4 = EvaluateSurface(Surface=reparameterize(boundary_3), Point=md_slider_4)  # -> Point, Normal, Frame

# ---- group: iso
orient = Orient(Geometry=scale_nu.Geometry, Source=evalsrf_4.Frame, Target=evalsrf_3.Frame)  # -> Geometry, Transform

# ----
debrep_3 = DeconstructBrep(Brep=orient.Geometry)  # -> Faces, Edges, Vertices
item_4 = ListItem(List=debrep_3.Faces, Index=[Slider(7, range=0..10), Slider(8, range=0..10)], Wrap=True)
edges_3 = BrepEdges(Brep=item_4)  # -> Naked, Interior, NonManifold
join = JoinCurves(Curves=edges_3.Naked, Preserve=False)  # -> flatten(Curves)
srfsplit = SurfaceSplit(Surface=flatten(geo), Curves=join)
item_5 = ListItem(List=srfsplit, Index=0, Wrap=True)
scale_nu_2 = ScaleNU(Geometry=orient.Geometry, Plane=pl, ScaleX=number_slider, ScaleY=number_slider, ScaleZ=1)  # -> Geometry, Transform
area_8 = Area(Geometry=scale_nu_2.Geometry)  # -> Area, Centroid

debrep_4 = DeconstructBrep(Brep=scale_nu_2.Geometry)  # -> Faces, Edges, Vertices
item_6 = ListItem(List=debrep_4.Faces, Index=[Slider(7, range=0..10), Slider(8, range=0..10)], Wrap=True)
edges_4 = BrepEdges(Brep=item_6)  # -> Naked, Interior, NonManifold
join_2 = JoinCurves(Curves=edges_4.Naked, Preserve=False)  # -> flatten(Curves)

scale_nu_3 = ScaleNU(Geometry=scale_nu_2.Geometry, Plane=pl, ScaleX=number_slider_2, ScaleY=number_slider_2, ScaleZ=1)  # -> Geometry, Transform
sdiff = SolidDifference(BrepsA=scale_nu_2.Geometry, BrepsB=scale_nu_3.Geometry)

debrep_5 = DeconstructBrep(Brep=sdiff)  # -> Faces, Edges, Vertices
item_7 = ListItem(List=debrep_5.Faces, Index=Slider(7, range=0..10), Wrap=True)
edges_5 = BrepEdges(Brep=item_7)  # -> Naked, Interior, NonManifold

area_9 = Area(Geometry=join_2)  # -> Area, Centroid
item_8 = ListItem(List=join_2, Index=0, Wrap=True)
item_9 = ListItem(List=area_9.Centroid, Index=0, Wrap=True)
join_3 = JoinCurves(Curves=edges_5.Naked, Preserve=False)

area_10 = Area(Geometry=brep_3)  # -> Area, Centroid
scale_3 = Scale(Geometry=brep_3, Center=item_9, Factor=Slider(0.9, range=0..1))  # -> Geometry, Transform
edges_6 = BrepEdges(Brep=scale_3.Geometry)  # -> Naked, Interior, NonManifold
crv_2 = Curve(edges_6.Naked)  # disabled

crv_3 = Curve(join_3)
item_10 = ListItem(List=crv_3, Index=Slider(0, range=0..1), Wrap=True)
item_11 = ListItem(List=crv_3, Index=Slider(1, range=0..1), Wrap=True)
srfsplit_2 = SurfaceSplit(Surface=flatten(geo), Curves=item_10)
extr = Extrude(Base=item_11, Direction=amp)

edges_7 = BrepEdges(Brep=extr)  # -> Naked, Interior, NonManifold
join_4 = JoinCurves(Curves=edges_7.Naked, Preserve=False)
crv_4 = Curve(join_4)
item_12 = ListItem(List=crv_4, Index=Slider(1, range=0..1), Wrap=True)

item_13 = ListItem(List=flatten(srfsplit_2), Index=0, Wrap=True)
boundary_4 = BoundarySurfaces(Edges=item_12)
merge = Merge(Data1=boundary_4, Data2=item_13, Data3=extr, Data4=brep_3, Data5=sdiff)
