# Grasshopper definition 140525_gimbal_03.gh (Grasshopper 0.9.76)

# Thread surfaces here
helix_points_number = Slider(60, range=10..300)
pitch_mm = Slider(2, range=0..10)
number_of_turns = Slider(5, range=0..200)
# ISO metric screw thread
d_mm = Slider(10, range=0..64)
div = Division(FirstNumber="2*pi", SecondNumber=expr("x-1", helix_points_number))
f_x_y = F2(Function="D/2-3^0.5*5*P/16", X=d_mm, Y=pitch_mm)
div_2 = Division(FirstNumber=pitch_mm, SecondNumber=expr("x-1", helix_points_number))
series = Series(Start=0, Step=div, Count=helix_points_number)
f_x_y_2 = F2(Function="D/2+P/(16*3^0.5)", X=d_mm, Y=pitch_mm)
f_x_y_3 = F2(Function="r-P/(8*3^0.5)", X=f_x_y, Y=pitch_mm)
series_2 = Series(Start=0, Step=div_2, Count=helix_points_number)
sin = Sine(Input=series)
cos = Cosine(Input=series)
pt_3 = ConstructPoint(XCoordinate=expr("9*x/16", pitch_mm), YCoordinate=0, ZCoordinate=expr("x/2", d_mm))
pt_2 = ConstructPoint(XCoordinate=expr("x/4", pitch_mm), YCoordinate=0, ZCoordinate=f_x_y)
pt_4 = ConstructPoint(XCoordinate=expr("11*x/16", pitch_mm), YCoordinate=0, ZCoordinate=expr("x/2", d_mm))
pt_1 = ConstructPoint(XCoordinate=0, YCoordinate=0, ZCoordinate=f_x_y)
pt_5 = ConstructPoint(XCoordinate=pitch_mm, YCoordinate=0, ZCoordinate=f_x_y)
pt_1_2 = ConstructPoint(XCoordinate=expr("x/8", pitch_mm), YCoordinate=0, ZCoordinate=f_x_y_3)
# Helix
mult = Multiplication(FirstNumber=f_x_y, SecondNumber=expr("x*-1", sin))
mult_2 = Multiplication(FirstNumber=f_x_y, SecondNumber=cos)
pt_3_4 = ConstructPoint(XCoordinate=expr("5*x/8", pitch_mm), YCoordinate=0, ZCoordinate=f_x_y_2)
series_3 = Series(Start=0, Step=pitch_mm, Count=number_of_turns)
pline = PolyLine(Vertices=[pt_4, pt_5], Closed=False)
arc = Arc3Pt(PointA=pt_3, PointB=pt_3_4, PointC=pt_4)  # -> Arc, Plane, Radius
pline_2 = PolyLine(Vertices=[pt_2, pt_3, pt_4, pt_5], Closed=False)
pline_3 = PolyLine(Vertices=[pt_1, pt_2, pt_3], Closed=False)
arc_2 = Arc3Pt(PointA=pt_1, PointB=pt_1_2, PointC=pt_2)  # -> Arc, Plane, Radius
pt = ConstructPoint(XCoordinate=series_2, YCoordinate=mult, ZCoordinate=mult_2)
pt_6 = ConstructPoint(XCoordinate=0, YCoordinate=0, ZCoordinate=0)
pt_7 = ConstructPoint(XCoordinate=pitch_mm, YCoordinate=0, ZCoordinate=0)
# Profiles
join = JoinCurves(Curves=[arc_2.Arc, pline_2], Preserve=False)
join_2 = JoinCurves(Curves=[arc.Arc, pline_3, pline], Preserve=False)
X = UnitX(Factor=series_3)
intcrv = Interpolate(Vertices=pt, Degree=3, Periodic=False)  # -> Curve, Length, Domain
ln = Line(StartPoint=pt_6, EndPoint=pt_7)
move = Move(Geometry=join_2, Translation=X)
move_2 = Move(Geometry=join, Translation=X)
join_3 = JoinCurves(Curves=move_2, Preserve=False)
railrev = RailRevolution(Curve=join_3, Rail=intcrv.Curve, Axis=ln, Scale=False)
external_male = BrepJoin(Breps=railrev)  # -> Breps, Closed
join_4 = JoinCurves(Curves=move, Preserve=False)
railrev_2 = RailRevolution(Curve=join_4, Rail=intcrv.Curve, Axis=ln, Scale=False)
internal_female = BrepJoin(Breps=railrev_2)  # -> Breps, Closed
crv = Curve(intcrv.Curve)
end = EndPoints(Curve=crv)  # -> Start, End
dist = Distance(PointA=end.Start, PointB=end.End)
panel = Panel(dist)
ln_2 = Line(StartPoint=end.Start, EndPoint=end.End)
data = Data("0.952331")
pl_origin = PlaneOrigin(Base=ln_2, Origin=end.Start)
pl_origin_2 = PlaneOrigin(Base=ln_2, Origin=end.Start)
panel_2 = Panel(data)
line = LineSDL(Start=pl_origin, Direction=pl_origin, Length=1)
multiplication = Multiplication(A=dist, B=Slider(9, range=0..10))
multiplication_2 = Multiplication(A=dist, B=Slider(5, range=0..10))
line_2 = LineSDL(Start=pl_origin_2, Direction=pl_origin_2, Length=1)
multiplication_3 = Multiplication(A=dist, B=Slider(9, range=0..10))
multiplication_4 = Multiplication(A=dist, B=Slider(1, range=0..10))
amp = Amplitude(Vector=line, Amplitude=multiplication_2)
planesrf = PlaneSurface(Plane=pl_origin, XSize=Domain(-10, 10), YSize=Domain(-10, 10))
amp_2 = Amplitude(Vector=line_2, Amplitude=multiplication_4)
planesrf_2 = PlaneSurface(Plane=pl_origin_2, XSize=Domain(-10, 10), YSize=Domain(-10, 10))
panel_3 = Panel(multiplication_2)
panel_4 = Panel(Slider(0.9, range=0..1))
move_3 = Move(Geometry=planesrf, Motion=amp)  # -> Geometry, Transform
move_4 = Move(Geometry=planesrf_2, Motion=amp_2)  # -> Geometry, Transform
amp_3 = Amplitude(Vector=pl_origin, Amplitude=multiplication_2)
amp_4 = Amplitude(Vector=line_2, Amplitude=expr("-x", multiplication_4))
extr = Extrude(Base=move_3.Geometry, Direction=amp_3)
extr_2 = Extrude(Base=move_4.Geometry, Direction=amp_4)
sdiff = SolidDifference(BrepsA=railrev, BrepsB=extr)
sdiff_2 = SolidDifference(BrepsA=sdiff, BrepsB=extr_2)
debrep = DeconstructBrep(Brep=sdiff_2)  # -> Faces, Edges, Vertices
item = ListItem(List=debrep.Faces, Index=Slider(12, range=0..16), Wrap=True)
number_slider = Slider(4, range=0..10)
number_slider_2 = Slider(0.5, range=0..1)
area = Area(Geometry=item)  # -> Area, Centroid
crv_2 = Curve([<curve referenced from the Rhino model> x2])
neg = Negative(Value=number_slider_2)
offset = Offset(Curve=crv_2, Distance=number_slider_2, Plane=PlaneXY(0, 0, 0), Corners=1)

crv_3 = Curve([<curve referenced from the Rhino model> x4])

item_2 = ListItem(List=crv_3, Index=[Slider(0, range=0..10), Slider(1, range=0..10)], Wrap=True)
end_2 = EndPoints(Curve=item_2)  # -> Start, End

vec2pt = Vector2Pt(PointA=area.Centroid, PointB=[end_2.End, end_2.Start], Unitize=False)  # -> Vector, Length
move_5 = Move(Geometry=sdiff_2, Motion=vec2pt.Vector)  # -> Geometry, Transform
number_slider_3 = Slider(1.01, range=0..10)  # disabled
offset_2 = Offset(Distance=0, Retrim=True)  # disabled

# ----
# ISO metric screw thread
# Thread surfaces here
# Iso metric screw thread generation for Rhinoceros on Grasshopper
# Laurent Delrieu 9/2011
# See preferred sizes on
# http://en.wikipedia.org/wiki/ISO_metric_screw_thread
# 
# P = Pitch (mm)
# D = Diameter (mm)
# 7 points coordinates in 2D)
# 1) {0, 		D/2-3^0.5*5P/16}
# 2) {P/8, 		D/2-3^0.5*5P/16-P/(3^0.5*8)}
# 3) {P/16, 		D-3^0.5*5P/8)/2}
# 4) {9P/16, 	D}
# 5) {5P/8,	 	D+P/(3^0.5*16)}
# 6) {11P/16, 	D}
# 7) {P,		D/2-3^0.5*5P/16}
helix_points_number_2 = Slider(13, range=10..300)
pitch_mm_2 = Slider(0.4, range=0..10)
number_of_turns_2 = Slider(3, range=0..200)
d_mm_2 = Slider(6.5, range=0..64)

# ----
# Profiles
panel_5 = Panel("D/2-3^0.5*5*P/16")
f_x_y_4 = F2(Function=panel_5, X=d_mm_2, Y=pitch_mm_2)
f_x_y_5 = F2(Function="D/2+P/(16*3^0.5)", X=d_mm_2, Y=pitch_mm_2)
f_x_y_6 = F2(Function="r-P/(8*3^0.5)", X=f_x_y_4, Y=pitch_mm_2)
pt_3_2 = ConstructPoint(XCoordinate=expr("9*x/16", pitch_mm_2), YCoordinate=0, ZCoordinate=expr("x/2", d_mm_2))
pt_2_2 = ConstructPoint(XCoordinate=expr("x/4", pitch_mm_2), YCoordinate=0, ZCoordinate=f_x_y_4)
pt_4_2 = ConstructPoint(XCoordinate=expr("11*x/16", pitch_mm_2), YCoordinate=0, ZCoordinate=expr("x/2", d_mm_2))
pt_1_3 = ConstructPoint(XCoordinate=0, YCoordinate=0, ZCoordinate=f_x_y_4)
pt_5_2 = ConstructPoint(XCoordinate=pitch_mm_2, YCoordinate=0, ZCoordinate=f_x_y_4)
pt_1_2_2 = ConstructPoint(XCoordinate=expr("x/8", pitch_mm_2), YCoordinate=0, ZCoordinate=f_x_y_6)
pt_3_4_2 = ConstructPoint(XCoordinate=expr("5*x/8", pitch_mm_2), YCoordinate=0, ZCoordinate=f_x_y_5)
series_4 = Series(Start=0, Step=pitch_mm_2, Count=number_of_turns_2)
pline_4 = PolyLine(Vertices=[pt_4_2, pt_5_2], Closed=False)
arc_3 = Arc3Pt(PointA=pt_3_2, PointB=pt_3_4_2, PointC=pt_4_2)  # -> Arc, Plane, Radius
pline_5 = PolyLine(Vertices=[pt_2_2, pt_3_2, pt_4_2, pt_5_2], Closed=False)
pline_6 = PolyLine(Vertices=[pt_1_3, pt_2_2, pt_3_2], Closed=False)
arc_4 = Arc3Pt(PointA=pt_1_3, PointB=pt_1_2_2, PointC=pt_2_2)  # -> Arc, Plane, Radius
join_5 = JoinCurves(Curves=[arc_4.Arc, pline_5], Preserve=False)
join_6 = JoinCurves(Curves=[arc_3.Arc, pline_6, pline_4], Preserve=False)
X_2 = UnitX(Factor=series_4)
move_6 = Move(Geometry=join_6, Translation=X_2)
move_7 = Move(Geometry=join_5, Translation=X_2)
join_7 = JoinCurves(Curves=move_7, Preserve=False)
join_8 = JoinCurves(Curves=move_6, Preserve=False)

# ----
# Helix
div_3 = Division(FirstNumber="2*pi", SecondNumber=expr("x-1", helix_points_number_2))
div_4 = Division(FirstNumber=pitch_mm_2, SecondNumber=expr("x-1", helix_points_number_2))
series_5 = Series(Start=0, Step=div_3, Count=helix_points_number_2)
series_6 = Series(Start=0, Step=div_4, Count=helix_points_number_2)
sin_2 = Sine(Input=series_5)
cos_2 = Cosine(Input=series_5)
mult_3 = Multiplication(FirstNumber=f_x_y_4, SecondNumber=expr("x*-1", sin_2))
mult_4 = Multiplication(FirstNumber=f_x_y_4, SecondNumber=cos_2)
pt_8 = ConstructPoint(XCoordinate=series_6, YCoordinate=mult_3, ZCoordinate=mult_4)
pt_9 = ConstructPoint(XCoordinate=0, YCoordinate=0, ZCoordinate=0)
pt_10 = ConstructPoint(XCoordinate=pitch_mm_2, YCoordinate=0, ZCoordinate=0)
intcrv_2 = Interpolate(Vertices=pt_8, Degree=3, Periodic=False)  # -> Curve, Length, Domain
ln_3 = Line(StartPoint=pt_9, EndPoint=pt_10)

railrev_3 = RailRevolution(Curve=join_8, Rail=intcrv_2.Curve, Axis=ln_3, Scale=False)
railrev_4 = RailRevolution(Curve=join_7, Rail=intcrv_2.Curve, Axis=ln_3, Scale=False)

external_male_2 = BrepJoin(Breps=railrev_4)  # -> Breps, Closed
internal_female_2 = BrepJoin(Breps=railrev_3)  # -> Breps, Closed

crv_4 = Curve(intcrv_2.Curve)
end_3 = EndPoints(Curve=crv_4)  # -> Start, End
dist_2 = Distance(PointA=end_3.Start, PointB=end_3.End)
ln_4 = Line(StartPoint=end_3.Start, EndPoint=end_3.End)

disc = Discontinuity(Curve=join_7, Level=1)  # -> Points, Parameters
explode = Explode(Curve=join_7, Recursive=True)  # -> Segments, Vertices
panel_6 = Panel(dist_2)
item_3 = ListItem(List=explode.Vertices, Index=0, Wrap=True)  # -> Item, Item1, Item2, Item3, Item4, Item5, Item6, Item7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
points = PointList(Points=explode.Vertices)

pl_origin_3 = PlaneOrigin(Base=ln_4, Origin=end_3.Start)
line_3 = LineSDL(Start=pl_origin_3, Direction=pl_origin_3, Length=1)
multiplication_5 = Multiplication(A=dist_2, B=Slider(9, range=0..10))
multiplication_6 = Multiplication(A=dist_2, B=Slider(1, range=0..10))
amp_5 = Amplitude(Vector=line_3, Amplitude=multiplication_6)
planesrf_3 = PlaneSurface(Plane=pl_origin_3, XSize=Domain(-10, 10), YSize=Domain(-10, 10))
move_8 = Move(Geometry=planesrf_3, Motion=amp_5)  # -> Geometry, Transform

dist_3 = Distance(PointA=item_3.Item, PointB=item_3.Item12)

pl_origin_4 = PlaneOrigin(Base=ln_4, Origin=end_3.Start)
line_4 = LineSDL(Start=pl_origin_4, Direction=pl_origin_4, Length=Slider(7, range=0..10))
multiplication_7 = Multiplication(A=dist_2, B=Slider(9, range=0..10))
multiplication_8 = Multiplication(A=dist_2, B=Slider(2.18, range=0..10))
planesrf_4 = PlaneSurface(Plane=pl_origin_4, XSize=Domain(-10, 10), YSize=Domain(-10, 10))
amp_6 = Amplitude(Vector=line_4, Amplitude=dist_3)
move_9 = Move(Geometry=planesrf_4, Motion=amp_6)  # -> Geometry, Transform

ln_5 = Line(StartPoint=item_3.Item, EndPoint=item_3.Item5)
panel_7 = Panel(dist_3)
multiplication_9 = Multiplication(A=dist_2, B=Slider(6, range=0..10))
amp_7 = Amplitude(Vector=line_4, Amplitude=multiplication_9)
amp_8 = Amplitude(Vector=line_3, Amplitude=expr("-x", multiplication_6))
extr_3 = Extrude(Base=move_9.Geometry, Direction=amp_7)
extr_4 = Extrude(Base=move_8.Geometry, Direction=amp_8)
sdiff_3 = SolidDifference(BrepsA=railrev_4, BrepsB=extr_3)
sdiff_4 = SolidDifference(BrepsA=sdiff_3, BrepsB=extr_4)
debrep_2 = DeconstructBrep(Brep=sdiff_4)  # -> Faces, Edges, Vertices
item_4 = ListItem(List=debrep_2.Faces, Index=Slider(12, range=0..16), Wrap=True)
area_2 = Area(Geometry=item_4)  # -> Area, Centroid
divide = DivideCurve(Curve=item_4, Count=Slider(4, range=0..10), Kinks=False)  # -> Points, Tangents, Parameters
item_5 = ListItem(List=divide.Points, Index=0, Wrap=True)
dist_4 = Distance(PointA=area_2.Centroid, PointB=item_5)
panel_8 = Panel(dist_4)
pipe = Pipe(Curve=crv_3, Radius=dist_4, Caps=0)
vec2pt_2 = Vector2Pt(PointA=area_2.Centroid, PointB=[end_2.End, end_2.Start], Unitize=False)  # -> Vector, Length
move_10 = Move(Geometry=sdiff_4, Motion=vec2pt_2.Vector)  # -> Geometry, Transform

pframe = PerpFrame(Curve=reparameterize(item_2), Parameter=Slider(1, range=0..1))
pframe_2 = PerpFrame(Curve=reparameterize(item_2), Parameter=Slider(0, range=0..1))
multiplication_10 = Multiplication(A=panel_8, B=Slider(2, range=0..10))
polygon = Polygon(Plane=pframe, Radius=multiplication_10, Segments=6, FilletRadius=0)  # -> Polygon, Length
polygon_2 = Polygon(Plane=pframe_2, Radius=multiplication_10, Segments=6, FilletRadius=0)  # -> Polygon, Length

X_3 = UnitX(Factor=Slider(10, range=0..10))
extr_5 = Extrude(Base=polygon_2.Polygon, Direction=X_3)
cap = CapHoles(Brep=extr_5)

X_4 = UnitX(Factor=Slider(10, range=0..10))
extr_6 = Extrude(Base=polygon.Polygon, Direction=X_4)
cap_2 = CapHoles(Brep=extr_6)

geo = Geometry([cap_2, cap])
sdiff_5 = SolidDifference(BrepsA=geo, BrepsB=move_5.Geometry)
join_9 = BrepJoin(Breps=sdiff_5)  # -> Breps, Closed; disabled
area_3 = Area(Geometry=geo)  # -> Area, Centroid; disabled
scale = Scale(Geometry=join_9.Breps, Center=area_3.Centroid, Factor=number_slider_3)  # -> Geometry, Transform; disabled
